# Dynamo graph Emboss.5.01.dyn (Dynamo 1.3.3.4651)

file_path = Filename(".\rgbb.jpg")
fromPath = FileObject(file_path)  # "File.FromPath"
readFromFile = Image.ReadFromFile(fromPath)
watch_image = WatchImageCore(readFromFile)
integer_slider = IntegerSlider(10, range=0..100 step 1)
integer_slider_2 = IntegerSlider(10, range=0..100 step 1)
file_path_2 = Filename(".\expo.txt")
code_block = CodeBlock { 10; }
pixels = Image.Pixels(image=readFromFile, xSamples=code_block, ySamples=code_block)
string_from_array = FromArray(pixels)
writeText = File.WriteText(file_path_2, string_from_array)
